# Dynamo graph WriteWall.dyn (Dynamo 2.0.2.6826)

string = StringInput("hello, world")
# note: Captains log
# Need to figure out how to update models based on values from csv file - need to leverage element ID so no monkey business happens with the lists, etc. The workflow I have in mind is a csv output file from revit, which goes to a python script, which goes back to input, which then is written back into the model. Probably need some sort of pretty looking shearwall spreadsheet for a typical engineer to be able to interface with, maybe also look into how to deploy dynamo code snippets into revit tools.
type = Object.Type(obj=string)
family_types = FamilyTypes(index=400)
all_elements_of_family_type = ElementsOfFamilyType(Family_Type=family_types)
string_2 = StringInput("Comments")
file_path = Filename(".\CSV_Input.csv")
boolean = BoolSelector(false)
importCSV = Data.ImportCSV(filePath=file_path, transpose=boolean)
watch = Watch(importCSV)
setParameterByName = Element.SetParameterByName(element=all_elements_of_family_type, parameterName=string_2, value=watch)
parameters = Element.Parameters(element=setParameterByName)
watch_2 = Watch(parameters)
